# Grasshopper definition zero.gh (Grasshopper 1.0.4)

# ---- group: 有问题
brep = Brep([<brep referenced from the Rhino model> x6])
w = WALL(name="wallpolygon", type="POLYGON")  # -> out, a, pts; inputs surfs: list of Brep
# ---------- w: Python ----------
"""Provides a scripting component.
    Inputs:
        name: wall的name
        type: one of RECT、POLYGON、INCLINED
    Output:
        a: The a output variable
"""

__author__ = "zhaorenfan"
__version__ = "2022.09.02"

ghenv.Component.Name = "WALL"
ghenv.Component.NickName = "w"
ghenv.Component.Message = "VER 0.0.1\nJULY_2_2022"
ghenv.Component.Category = "ZRF"
ghenv.Component.SubCategory = "0 | ZRF"

import rhinoscriptsyntax as rs
import Rhino as rc
import ghpythonlib.components as gh

if len(name)==0:
    name="wall"
a = []
pts = []
i = 1

if type == "RECT":
    for surf in surfs:
        _, _, Vt = gh.DeconstructBrep(surf)
        # print(Vt)
        p1 = Vt[0]
        
        xmin = p1[0]
        ymin = p1[1]
        zmin = p1[2]
        xmax = p1[0]
        ymax = p1[1]
        zmax = p1[2]
        for p in Vt:
            xmin = min(xmin, p[0])
            ymin = min(ymin, p[1])
            zmin = min(zmin, p[2])
            xmax = max(xmax, p[0])
            ymax = max(ymax, p[1])
            zmax = max(zmax, p[2])
        pmin = rc.Geometry.Point3d(xmin,ymin,zmin)
        pmax = rc.Geometry.Point3d(xmax,ymax,zmax)
        pts.append(pmin)
        pts.append(pmax)
        
        v = "WALL "+name+"."+str(i)+" "+ type
        i += 1
        v+=" PSTART {"+str(pmin)+"} "+"PEND {"+str(pmax)+"}"
        a.append(v)

if type=="POLYGON":
    for surf in surfs:
        #print(surf)
        F, E, Vt = gh.DeconstructBrep(surf)

        #print("111")
        print(rs.IsSurfaceTrimmed(surf))

        pt_str = ""
        si = 1   # 点的数量
        for p in Vt:
            pts.append(p)
            r = " VERT"+str(si)+" {"+str(p)+"}"
            pt_str+=r
            si+=1
        # print(pt_str)
        v = "WALL "+name+"."+str(i) + " " +type + " NVERTS "+str(si-1)
        i += 1
        v+=pt_str
        a.append(v)

if type == "INCLINED":
    for surf in surfs:
        _, _, Vt = gh.DeconstructBrep(surf)
        # print(Vt)
        pS = Vt[0]
        pE = Vt[0]
        nor = rs.SurfaceNormal(surf, pS)  #平面法向量
        axis = 0
        angle = 0
        if nor[0]==0:
            axis = 0
            # 与平面xy夹角(0,0,1)
            n0 = rc.Geometry.Vector3d(0,0,1)
            angle = rs.VectorAngle(n0, nor)

        elif nor[1]==0:
            axis = 1
            n0 = rc.Geometry.Vector3d(0,0,1)
            angle = rs.VectorAngle(n0, nor)

        elif nor[2]==0:
            axis = 2
            n0 = rc.Geometry.Vector3d(0,-1,0)
            angle = rs.VectorAngle(n0, nor)
        # angle = rs.VectorAngle(n0, nor)
        print("angle:", angle)
        print("axis:",axis)
        print(nor)
        for p in Vt:
            l1 = rs.VectorSubtract(p, pS)
            l2 = rs.VectorSubtract(pE, pS)
            if l1>l2:
                pE = p
        pts.append(pS)
        pts.append(pE)
        diff = rs.VectorSubtract(pE, pS)
        # setval point1 {0.05 0.22 1.78} point2 {1.28 1.45 3.0} diff {1.2 1.2 1.2} diff2 {1.2 1.7 0} volume_flag {1} 
        # split_flag {0} plate_flag {1} diff_flag {2} axis {0} rotate_sign {1} rotate_angle {45} thickness {0}
        v = "WALL "+name+"."+str(i)+" "+ type
        i += 1
        v+=" PSTART {"+str(pS)+"} "+"PEND {"+str(pE)+"}"
#       v+=" PSTART {"+str(pS)+"} "+"PEND {"+str(pE)+"}" + " DIFF {" + str(diff)+"}"
        v+=" AXIS "+str(axis)+" ANGLE "+ str(angle)
        a.append(v)
# ---------- end w ----------

# ----
brep_2 = Brep([<brep referenced from the Rhino model> x3])
w_2 = WALL(name="wallinc", type="INCLINED", surfs=brep_2)  # -> out, a, pts; inputs surfs: list of Brep
# ---------- w_2: Python ----------
"""Provides a scripting component.
    Inputs:
        name: wall的name
        type: one of RECT、POLYGON、INCLINED
    Output:
        a: The a output variable
"""

__author__ = "zhaorenfan"
__version__ = "2022.09.02"

ghenv.Component.Name = "WALL"
ghenv.Component.NickName = "w"
ghenv.Component.Message = "VER 0.0.1\nJULY_2_2022"
ghenv.Component.Category = "ZRF"
ghenv.Component.SubCategory = "0 | ZRF"

import rhinoscriptsyntax as rs
import Rhino as rc
import ghpythonlib.components as gh
import math

if len(name)==0:
    name="wall"
a = []
pts = []
i = 1

if type == "RECT":
    for surf in surfs:
        _, _, Vt = gh.DeconstructBrep(surf)
        # print(Vt)
        p1 = Vt[0]
        
        xmin = p1[0]
        ymin = p1[1]
        zmin = p1[2]
        xmax = p1[0]
        ymax = p1[1]
        zmax = p1[2]
        for p in Vt:
            xmin = min(xmin, p[0])
            ymin = min(ymin, p[1])
            zmin = min(zmin, p[2])
            xmax = max(xmax, p[0])
            ymax = max(ymax, p[1])
            zmax = max(zmax, p[2])
        pmin = rc.Geometry.Point3d(xmin,ymin,zmin)
        pmax = rc.Geometry.Point3d(xmax,ymax,zmax)
        pts.append(pmin)
        pts.append(pmax)
        
        v = "WALL "+name+"."+str(i)+" "+ type
        i += 1
        v+=" PSTART {"+str(pmin)+"} "+"PEND {"+str(pmax)+"}"
        a.append(v)

if type=="POLYGON":
    for surf in surfs:
        _, _, Vt = gh.DeconstructBrep(surf)
        pt_str = ""
        si = 1   # 点的数量
        for p in Vt:
            pts.append(p)
            r = " VERT"+str(si)+" {"+str(p)+"}"
            pt_str+=r
            si+=1
        # print(pt_str)
        v = "WALL "+name+"."+str(i) + " " +type + " NVERTS "+str(si-1)
        i += 1
        v+=pt_str
        a.append(v)

if type == "INCLINED":
    for surf in surfs:
        _, _, Vt = gh.DeconstructBrep(surf)
        # print(Vt)
        pS = Vt[0]
        pE = Vt[0]
        nor = rs.SurfaceNormal(surf, pS)  #平面法向量
        print(nor)
        axis = 0
        angle = 0
        n0 = rc.Geometry.Vector3d(0,0,0)
        if abs(nor[0])<=1e-3:
            axis = 0
            # 与平面xy夹角(0,0,1)
            n0 = rc.Geometry.Vector3d(0,0,1)
            angle = rs.VectorAngle(n0, nor)
            print("aaaaa")

        elif abs(nor[1])<=1e-3:
            axis = 1
            n0 = rc.Geometry.Vector3d(0,0,1)
            angle = rs.VectorAngle(n0, nor)

        elif abs(nor[2])<=1e-3:
            axis = 2
            n0 = rc.Geometry.Vector3d(0,-1,0)
            angle = rs.VectorAngle(n0, nor)
        # angle = rs.VectorAngle(n0, nor)
        print("angle:", angle)
        print("axis:",axis)
        print(nor)
        for p in Vt:
            l1 = rs.VectorSubtract(p, pS)
            l2 = rs.VectorSubtract(pE, pS)
            # 这里有问题
            #if l1>l2:
            if rs.VectorLength(l1)>rs.VectorLength(l2):
                pE = p
        pts.append(pS)
        pts.append(pE)
        diff = rs.VectorSubtract(pE, pS)
        # setval point1 {0.05 0.22 1.78} point2 {1.28 1.45 3.0} diff {1.2 1.2 1.2} diff2 {1.2 1.7 0} volume_flag {1} 
        # split_flag {0} plate_flag {1} diff_flag {2} axis {0} rotate_sign {1} rotate_angle {45} thickness {0}
        v = "WALL "+name+"."+str(i)+" "+ type
        i += 1
        v+=" PSTART {"+str(pS)+"} "+"PEND {"+str(pE)+"}"
#       v+=" PSTART {"+str(pS)+"} "+"PEND {"+str(pE)+"}" + " DIFF {" + str(diff)+"}"
        v+=" AXIS "+str(axis)+" ANGLE "+ str(angle)
        a.append(v)
# ---------- end w_2 ----------
brep_3 = Brep([<brep referenced from the Rhino model> x54])
brep_4 = Brep([<brep referenced from the Rhino model> x3])
brep_5 = Brep([<brep referenced from the Rhino model> x18])
brep_6 = Brep([<brep referenced from the Rhino model> x3])
panel = Panel(w.a)
panel_2 = Panel(w_2.a)
w_3 = WALL(name="wallrect", type="RECT", surfs=brep_3)  # -> out, a, pts; inputs surfs: list of Brep
# ---------- w_3: Python ----------
"""Provides a scripting component.
    Inputs:
        name: wall的name
        type: one of RECT、POLYGON、INCLINED
    Output:
        a: The a output variable
"""

__author__ = "zhaorenfan"
__version__ = "2022.09.02"

ghenv.Component.Name = "WALL"
ghenv.Component.NickName = "w"
ghenv.Component.Message = "VER 0.0.1\nJULY_2_2022"
ghenv.Component.Category = "ZRF"
ghenv.Component.SubCategory = "0 | ZRF"

import rhinoscriptsyntax as rs
import Rhino as rc
import ghpythonlib.components as gh

if len(name)==0:
    name="wall"
a = []
pts = []
i = 1

if type == "RECT":
    for surf in surfs:
        _, _, Vt = gh.DeconstructBrep(surf)
        # print(Vt)
        p1 = Vt[0]
        
        xmin = p1[0]
        ymin = p1[1]
        zmin = p1[2]
        xmax = p1[0]
        ymax = p1[1]
        zmax = p1[2]
        for p in Vt:
            xmin = min(xmin, p[0])
            ymin = min(ymin, p[1])
            zmin = min(zmin, p[2])
            xmax = max(xmax, p[0])
            ymax = max(ymax, p[1])
            zmax = max(zmax, p[2])
        pmin = rc.Geometry.Point3d(xmin,ymin,zmin)
        pmax = rc.Geometry.Point3d(xmax,ymax,zmax)
        pts.append(pmin)
        pts.append(pmax)
        
        v = "WALL "+name+"."+str(i)+" "+ type
        i += 1
        v+=" PSTART {"+str(pmin)+"} "+"PEND {"+str(pmax)+"}"
        a.append(v)

if type=="POLYGON":
    for surf in surfs:
        _, _, Vt = gh.DeconstructBrep(surf)
        pt_str = ""
        si = 1   # 点的数量
        for p in Vt:
            pts.append(p)
            r = " VERT"+str(si)+" {"+str(p)+"}"
            pt_str+=r
            si+=1
        # print(pt_str)
        v = "WALL "+name+"."+str(i) + " " +type + " NVERTS "+str(si-1)
        i += 1
        v+=pt_str
        a.append(v)

if type == "INCLINED":
    for surf in surfs:
        _, _, Vt = gh.DeconstructBrep(surf)
        # print(Vt)
        pS = Vt[0]
        pE = Vt[0]
        nor = rs.SurfaceNormal(surf, pS)  #平面法向量
        axis = 0
        angle = 0
        if nor[0]==0:
            axis = 0
            # 与平面xy夹角(0,0,1)
            n0 = rc.Geometry.Vector3d(0,0,1)
            angle = rs.VectorAngle(n0, nor)

        elif nor[1]==0:
            axis = 1
            n0 = rc.Geometry.Vector3d(0,0,1)
            angle = rs.VectorAngle(n0, nor)

        elif nor[2]==0:
            axis = 2
            n0 = rc.Geometry.Vector3d(0,-1,0)
            angle = rs.VectorAngle(n0, nor)
        # angle = rs.VectorAngle(n0, nor)
        print("angle:", angle)
        print("axis:",axis)
        print(nor)
        for p in Vt:
            l1 = rs.VectorSubtract(p, pS)
            l2 = rs.VectorSubtract(pE, pS)
            if l1>l2:
                pE = p
        pts.append(pS)
        pts.append(pE)
        diff = rs.VectorSubtract(pE, pS)
        # setval point1 {0.05 0.22 1.78} point2 {1.28 1.45 3.0} diff {1.2 1.2 1.2} diff2 {1.2 1.7 0} volume_flag {1} 
        # split_flag {0} plate_flag {1} diff_flag {2} axis {0} rotate_sign {1} rotate_angle {45} thickness {0}
        v = "WALL "+name+"."+str(i)+" "+ type
        i += 1
        v+=" PSTART {"+str(pS)+"} "+"PEND {"+str(pE)+"}"
#       v+=" PSTART {"+str(pS)+"} "+"PEND {"+str(pE)+"}" + " DIFF {" + str(diff)+"}"
        v+=" AXIS "+str(axis)+" ANGLE "+ str(angle)
        a.append(v)
# ---------- end w_3 ----------
pr = PRISM(name="prism", type="FLUID", breps=brep_6)  # -> out, a, pts, Height; inputs breps: list of Brep
# ---------- pr: Python ----------
__author__ = "zhaorenfan"
__version__ = "2022.09.03"

ghenv.Component.Name = "PRISM"
ghenv.Component.NickName = "pr"
ghenv.Component.Message = "VER 0.0.1\nSept_3_2022"
ghenv.Component.Category = "ZRF"
ghenv.Component.SubCategory = "0 | ZRF"

import rhinoscriptsyntax as rs
import Rhino as rc
import ghpythonlib.components as gh




pts = []
a = []
Height = []
if len(name)==0:
    name = "prism"
if len(type) == 0:
    type = "FLUID"

i = 1
print(len(breps))
for brep in breps:
    F, E, V = gh.DeconstructBrep(brep)
    tri1 = ""
    tri2 = ""
    numOfTri = 0
    for f in F:
        print(f)
        if rs.IsSurfaceTrimmed(f):
            if tri1=="":
                tri1 = f
            else:
                tri2 = f
            numOfTri += 1
    print(numOfTri)
    print(tri1)
    print(tri2)
    _, _, Pts1 = gh.DeconstructBrep(tri1)
    for p in Pts1:
        pts.append(p)
    _, _, Pts2 = gh.DeconstructBrep(tri2)
    p1 = Pts1[0]
    p2 = ""
    for p in Pts2:
        n1 = 0
        n2 = 0
        for x in range(3):
            p1x = p1[x]
            p2x = p[x]
            if p1x==p2x:
                n1+=1
            else:
                n2+=1
        if n1 == 2 and n2 ==1:
            p2 = p
            pts.append(p2)
            break
    print(p1)
    print(p2)
    d = rs.VectorSubtract(p2, p1)
    print(d)
    h = d[0]+d[1]+d[2]
    Height.append(h)
    
    # PRISM prism.1 FLUID VERT1 {-4,3,0} VERT2 {0,3,6} VERT3 {0,3,6} HEIGHT 1
    v = "PRISM "+name+"."+str(i)+" "+type
    i+=1
    v+=" VERT1 {"+str(Pts1[0])+"} "+"VERT2 {"+str(Pts1[1])+"}"+" VERT3 {"+str(Pts1[2])+"}"
    v+=" HEIGHT "+str(h)
    a.append(v)
# ---------- end pr ----------
blk = BLOCK(name="block", type="FLUID", breps=brep_5)  # -> out, a, V; inputs breps: list of Brep
# ---------- blk: Python ----------
__author__ = "zhaorenfan"
__version__ = "2022.09.02"

ghenv.Component.Name = "BLOCK"
ghenv.Component.NickName = "blk"
ghenv.Component.Message = "VER 0.0.1\nJULY_2_2022"
ghenv.Component.Category = "ZRF"
ghenv.Component.SubCategory = "0 | ZRF"

import rhinoscriptsyntax as rs
import Rhino as rc
import ghpythonlib.components as gh

def findPoints(Vertex):
    print(Vertex)
    xmin = Vertex[0][0]
    ymin = Vertex[0][1]
    zmin = Vertex[0][2]
    xmax = Vertex[0][0]
    ymax = Vertex[0][1]
    zmax = Vertex[0][2]
    for v in Vertex:
        xmin = min(xmin, v[0])
        ymin = min(ymin, v[1])
        zmin = min(zmin, v[2])
        
        xmax = max(xmax, v[0])
        ymax = max(ymax, v[1])
        zmax = max(zmax, v[2])
    pmin = rc.Geometry.Point3d(xmin,ymin,zmin)
    pmax = rc.Geometry.Point3d(xmax,ymax,zmax)
    return pmin, pmax


V = []
a = []
if len(name)==0:
    name = "block"
if len(type) == 0:
    type = "FLUID"

i = 1
print(len(breps))
for brep in breps:
    _, _, Vt = gh.DeconstructBrep(brep)
    print(brep)
    v = "BLOCK "+name+"."+str(i)+" "+type
    i+=1
    p1, p2 = findPoints(Vt)
    v+=" PSTART {"+str(p1)+"} "+"PEND {"+str(p2)+"}"
    a.append(v)
    
    for vertex in Vt:
        p = rc.Geometry.Point3d(vertex)
        V.append(p)
# ---------- end blk ----------
o = OPENING(name="opening", surfs=brep_4)  # -> out, a, pts; inputs surfs: list of Surface
# ---------- o: Python ----------
"""Provides a scripting component.
    Inputs:
        name: opening的名字
        surfs: opening的brep类型的表面
    Output:
        a: 输出自定义的文本
        pts: 参考点
"""

__author__ = "zhaorenfan"
__version__ = "2022.09.02"

ghenv.Component.Name = "OPENING"
ghenv.Component.NickName = "o"
ghenv.Component.Message = "VER 0.0.1\nJULY_2_2022"
ghenv.Component.Category = "ZRF"
ghenv.Component.SubCategory = "0 | ZRF"

import rhinoscriptsyntax as rs
import Rhino as rc
import ghpythonlib.components as gh

if len(name)==0:
    name="opening"
a = []
pts = []
i = 1
for surf in surfs:
    _, _, Vt = gh.DeconstructBrep(surf)
    # print(Vt)
    p1 = Vt[0]
    
    xmin = p1[0]
    ymin = p1[1]
    zmin = p1[2]
    xmax = p1[0]
    ymax = p1[1]
    zmax = p1[2]
    for p in Vt:
        xmin = min(xmin, p[0])
        ymin = min(ymin, p[1])
        zmin = min(zmin, p[2])
        xmax = max(xmax, p[0])
        ymax = max(ymax, p[1])
        zmax = max(zmax, p[2])
    pmin = rc.Geometry.Point3d(xmin,ymin,zmin)
    pmax = rc.Geometry.Point3d(xmax,ymax,zmax)
    pts.append(pmin)
    pts.append(pmax)
    
    v = "OPENING "+name+"."+str(i)
    i += 1
    v+=" PSTART {"+str(pmin)+"} "+"PEND {"+str(pmax)+"}"
    a.append(v)
# ---------- end o ----------
panel_3 = Panel(w_3.a)
panel_4 = Panel(blk.a)
panel_5 = Panel(pr.a)
panel_6 = Panel(o.a)
merge = Merge(Data1="DOMAIN room.1", Data2=panel_4, Data3=panel_3, Data4=panel_6, Data5=panel_5, Data6=w.a, Data7=w_2.a)
panel_7 = Panel(merge)
